# Grasshopper definition 3.1_sending_messages_to_grasshopper.gh (Grasshopper 1.0.7)

# Receiving a value
file_path = FilePath("/Users/provolot/github-special/metatool-psychecomputer/tinkering_with_python/data.txt")
# Splitting a string into values
panel = Panel(file_path)
read_file = ReadFile(File=file_path, PerLineParse=True)
panel_2 = Panel("10,200,50")
panel_3 = Panel(read_file)
# Executing Rhino Command Macros
# See: https://developer.rhino3d.com/guides/general/creating-command-macros/
read_file_2 = ReadFile(File=file_path, PerLineParse=True)  # disabled
read_file_3 = ReadFile(File=file_path, PerLineParse=True)  # disabled
colour_rgb = ColourRGB(Alpha=255, Red=read_file, Green=read_file, Blue=0)
panel_4 = Panel(read_file_3)
sphere = Sphere(Base=PlaneXY(0, 0, 0), Radius=panel_3)
panel_5 = Panel("! Save")
panel_6 = Panel(read_file_2)
panel_7 = Panel("! SelAll Delete _Enter")
panel_8 = Panel("""! _Perspective
 !""")
panel_9 = Panel("! _Top !")
text_split = TextSplit(Text=panel_4, Separators=",")
custom_preview = CustomPreview(Geometry=sphere, Material=colour_rgb)
run_rhino_command = GhPythonScript(activate=Toggle(False), command=panel_6)  # -> out, a; inputs activate: Boolean
# ---------- run_rhino_command: Python ----------
import rhinoscriptsyntax as rs
if(activate):
    rs.Command(command)
# ---------- end run_rhino_command ----------
list_item = ListItem(List=text_split, Index=0, Wrap=True)  # -> Item, Item1, Item2
sphere_2 = Sphere(Base=PlaneXY(0, 0, 0), Radius=Slider(50, range=0..100))
colour_rgb_2 = ColourRGB(Alpha=255, Red=list_item.Item, Green=list_item.Item1, Blue=list_item.Item2)
custom_preview_2 = CustomPreview(Geometry=sphere_2, Material=colour_rgb_2)
